# Grasshopper definition KinergyMainInterface.gh (Grasshopper 1.0.7)
# plug-ins: Human UI

height = Slider(34, range=0..1000)
width = Slider(100, range=0..1000)
panel = Panel("""Short
Long
Longer""")
height_2 = Slider(30, range=0..30)
width_2 = Slider(50, range=0..400)
height_3 = Slider(30, range=0..30)
width_3 = Slider(50, range=0..400)
height_4 = Slider(34, range=0..1000)
width_4 = Slider(110, range=0..1000)
pulldown = CreatePulldownMenu(Label="Dis", ListItems=panel, showLabel=True)
adjustpos = AdjustElementPositioning(
    ElementsToAdjust=pulldown,
    Margin="227,-45,0,10",
    AbsolutePositioning=False,
    Width=width,
    Height=height,
    HorizontalAlignment=Slider(0, range=0..100))
label = CreateLabel(LabelText="(0°-90°)", LabelSize=12, Justification=0)
label_2 = CreateLabel(LabelText="Fatest", LabelSize=12, Justification=0)
panel_2 = Panel("""small
medium
big""")
adjustpos_2 = AdjustElementPositioning(
    ElementsToAdjust=label,
    Margin="5,-13,0,0",
    AbsolutePositioning=False,
    Width=width_2,
    Height=height_2,
    HorizontalAlignment=Slider(0, range=0..100))
adjustelem = AdjustElementAppearance(ElementsToAdjust=label, Background="255,255,255")
adjustpos_3 = AdjustElementPositioning(
    ElementsToAdjust=label_2,
    Margin="290,-75,0,5",
    AbsolutePositioning=False,
    Width=width_3,
    Height=height_3,
    HorizontalAlignment=Slider(0, range=0..100))
adjustelem_2 = AdjustElementAppearance(ElementsToAdjust=label_2, Background="255,255,255")
pulldown_2 = CreatePulldownMenu(Label="Amp", ListItems=panel_2, showLabel=True)
adjustpos_4 = AdjustElementPositioning(
    ElementsToAdjust=pulldown_2,
    Margin="218,-45,0,10",
    AbsolutePositioning=False,
    Width=width_4,
    Height=height_4,
    HorizontalAlignment=Slider(0, range=0..100))
speed = Slider(4, range=0..9)
slider = CreateSlider(Slider=speed, ShowBounds=False, ShowTicks=False, ShowTooltip=False, ShowValLabel=True, showLabel=True)

# ---- group: Entry Interface
height_5 = Slider(35, range=0..1000)
width_5 = Slider(186, range=0..1000)
height_6 = Slider(35, range=0..1000)
width_6 = Slider(186, range=0..1000)
width_7 = Slider(186, range=0..1000)
label_3 = CreateLabel(LabelText="Periodic Motion", LabelSize=12, Justification=0)
adjustpos_5 = AdjustElementPositioning(
    ElementsToAdjust=label_3,
    Margin="40,40,0,5",
    AbsolutePositioning=False,
    Width=width_5,
    Height=height_5,
    HorizontalAlignment=Slider(0, range=0..100))
height_7 = Slider(35, range=0..1000)
label_4 = CreateLabel(LabelText="Non-periodic Motion", LabelSize=12, Justification=0)
adjustpos_6 = AdjustElementPositioning(
    ElementsToAdjust=label_4,
    Margin="10,30,0,5",
    AbsolutePositioning=False,
    Width=width_6,
    Height=height_6,
    HorizontalAlignment=Slider(0, range=0..100))
width_8 = Slider(120, range=0..1000)
width_9 = Slider(150, range=0..1000)
height_8 = Slider(35, range=0..1000)
height_9 = Slider(35, range=0..1000)
height_10 = Slider(35, range=0..1000)
width_10 = Slider(150, range=0..1000)
height_11 = Slider(35, range=0..1000)
width_11 = Slider(150, range=0..1000)
width_12 = Slider(150, range=0..1000)
height_12 = Slider(35, range=0..1000)
height_13 = Slider(35, range=0..1000)
width_13 = Slider(150, range=0..1000)
width_14 = Slider(329, range=0..1000)
height_14 = Slider(35, range=0..1000)
titlesize = Slider(20, range=0..30)
radiobtn = CreateRadioButton(RadioButtonName="Continuous rotation", RadioButtonGroup="motion type", InitiallySelected=False)
adjustpos_7 = AdjustElementPositioning(
    ElementsToAdjust=radiobtn,
    Margin="150,-120,0,10",
    AbsolutePositioning=False,
    Width=width_9,
    Height=height_9,
    HorizontalAlignment=Slider(0, range=0..100))
radiobtn_2 = CreateRadioButton(RadioButtonName="Reciprocation", RadioButtonGroup="motion type", InitiallySelected=False)
adjustpos_8 = AdjustElementPositioning(
    ElementsToAdjust=radiobtn_2,
    Margin="150,-70,0,10",
    AbsolutePositioning=False,
    Width=width_10,
    Height=height_11,
    HorizontalAlignment=Slider(0, range=0..100))
radiobtn_3 = CreateRadioButton(RadioButtonName="Intermittent Oscillation", RadioButtonGroup="motion type", InitiallySelected=False)
adjustpos_9 = AdjustElementPositioning(
    ElementsToAdjust=radiobtn_3,
    Margin="150,-30,0,10",
    AbsolutePositioning=False,
    Width=width_11,
    Height=height_12,
    HorizontalAlignment=Slider(0, range=0..100))
radiobtn_4 = CreateRadioButton(RadioButtonName="Intermittent Rotation", RadioButtonGroup="motion type", InitiallySelected=False)
adjustpos_10 = AdjustElementPositioning(
    ElementsToAdjust=radiobtn_4,
    Margin="150,-15,0,10",
    AbsolutePositioning=False,
    Width=width_12,
    Height=height_13,
    HorizontalAlignment=Slider(0, range=0..100))
radiobtn_5 = CreateRadioButton(RadioButtonName="Instant translation", RadioButtonGroup="motion type", InitiallySelected=False)
adjustpos_11 = AdjustElementPositioning(
    ElementsToAdjust=radiobtn_5,
    Margin="150,-95,0,10",
    AbsolutePositioning=False,
    Width=width_7,
    Height=height_7,
    HorizontalAlignment=Slider(0, range=0..100))
radiobtn_6 = CreateRadioButton(RadioButtonName="Continuous translation", RadioButtonGroup="motion type", InitiallySelected=False)
adjustpos_12 = AdjustElementPositioning(
    ElementsToAdjust=radiobtn_6,
    Margin="150,-20,0,10",
    AbsolutePositioning=False,
    Width=width_13,
    Height=height_10,
    HorizontalAlignment=Slider(0, range=0..100))
radiobtn_7 = CreateRadioButton(RadioButtonName="Instant rotation", RadioButtonGroup="motion type", InitiallySelected=False)
adjustpos_13 = AdjustElementPositioning(
    ElementsToAdjust=radiobtn_7,
    Margin="150,-45,0,10",
    AbsolutePositioning=False,
    Width=width_8,
    Height=height_8,
    HorizontalAlignment=Slider(0, range=0..100))
label_5 = CreateLabel(LabelText="Select a target motion type:", LabelSize=12, Justification=0)
adjustpos_14 = AdjustElementPositioning(
    ElementsToAdjust=label_5,
    Margin="0,0,0,5",
    AbsolutePositioning=False,
    Width=width_14,
    Height=height_14,
    HorizontalAlignment=Slider(0, range=0..100))
adjustelem_3 = AdjustElementAppearance(ElementsToAdjust=label_5, FontSize=titlesize)

# ----
number_slider = Slider(940, range=0..1000)
number_slider_2 = Slider(400, range=0..1000)

# ---- group: Motion Selection
values = ValueListener(Elements=radiobtn_5, SomeProperty=True)  # -> Values, Indices
values_2 = ValueListener(Elements=radiobtn_7, SomeProperty=True)  # -> Values, Indices
values_3 = ValueListener(Elements=radiobtn_6, SomeProperty=True)  # -> Values, Indices
values_4 = ValueListener(Elements=radiobtn, SomeProperty=True)  # -> Values, Indices
values_5 = ValueListener(Elements=radiobtn_2, SomeProperty=True)  # -> Values, Indices
values_6 = ValueListener(Elements=radiobtn_4, SomeProperty=True)  # -> Values, Indices
values_7 = ValueListener(Elements=radiobtn_3, SomeProperty=True)  # -> Values, Indices
python = GhPythonScript(
    x=values.Values,
    y=values_2.Values,
    z=values_3.Values,
    u=values_4.Values,
    v=values_5.Values,
    w=values_7.Values,
    s=values_6.Values)  # -> a, b, c, d, e, f, g, h
# ---------- python: Python ----------
#provides a scripting component.
#    Inputs:
#        x: Instant translation
#        y: Instant rotation
#        z: Continuous translation
#        u: Continuous rotation
#        v: Reciprocation
#        w: Intermittent oscillation
#        s: Intermittent rotation
#    Output:
#        a: Visibility indicator for instant translation control panel
#        b: Visibility indicator for instant rotation control panel
#        c: Visibility indicator for continuous translation control panel
#        d: Visibility indicator for continuous rotation control panel
#        e: Visibility indicator for the default control panel
#        f: Visibility indicator for reciprocation control panel
#        g: Visibility indicator for intermittent oscillation control panel
#        h: Visibility indicator for intermittent rotation control panel
#
#__author__ = "ediga"
#__version__ = "2020.07.28"

import rhinoscriptsyntax as rs


if x and not y and not z and not u and not v and not w and not s:
    a = True
    b = False
    c = False
    d = False
    e = False
    f = False
    g = False
    h = False
elif not x and y and not z and not u and not v and not w and not s:
    a = False
    b = True
    c = False
    d = False
    e = False
    f = False
    g = False
    h = False
elif not x and not y and z and not u and not v and not w and not s:
    a = False
    b = False
    c = True
    d = False
    e = False
    f = False
    g = False
    h = False
elif not x and not y and not z and u and not v and not w and not s:
    a = False
    b = False
    c = False
    d = True
    e = False
    f = False
    g = False
    h = False
elif not x and not y and not z and not u and v and not w and not s:
    a = False
    b = False
    c = False
    d = False
    e = False
    f = True
    g = False
    h = False
elif not x and not y and not z and not u and not v and w and not s:
    a = False
    b = False
    c = False
    d = False
    e = False
    f = False
    g = True
    h = False
elif not x and not y and not z and not u and not v and not w and s:
    a = False
    b = False
    c = False
    d = False
    e = False
    f = False
    g = False
    h = True
else:
    a = False
    b = False
    c = False
    d = False
    e = True
    f = False
    g = False
    h = False
# ---------- end python ----------
instant_rotation = Panel(values_2.Values)
instant_translation = Panel(values.Values)
continuous_translation = Panel(values_3.Values)
continuous_rotation = Panel(values_4.Values)
intermittent_oscillation = Panel(values_7.Values)
reciprocation = Panel(values_5.Values)
intermittent_rotation = Panel(values_6.Values)

# ---- group: Intermittent Oscillation Control Panel
height_15 = Slider(30, range=0..30)
width_15 = Slider(50, range=0..400)
label_6 = CreateLabel(LabelText="Fastest", LabelSize=12, Justification=0)
adjustpos_15 = AdjustElementPositioning(
    ElementsToAdjust=label_6,
    Margin="286,-45,0,5",
    AbsolutePositioning=False,
    Width=width_15,
    Height=height_15,
    HorizontalAlignment=Slider(0, range=0..100))
adjustelem_4 = AdjustElementAppearance(ElementsToAdjust=label_6, Background="255,255,255")
height_16 = Slider(34, range=0..1000)
width_16 = Slider(110, range=0..1000)
width_17 = Slider(80, range=0..1000)
height_17 = Slider(30, range=0..1000)
c_script = CSharpScript()  # -> out, A
# ---------- c_script: C# ----------
    GH_Document gh_d = owner.OnPingDocument();

    if (gh_d.IsFilePathDefined)
    {
      Print("A path is defined.");
      A = gh_d.FilePath;
    }
    else
    {
      Print("No path defined.");
    }
# ---------- end c_script ----------
python_2 = GhPythonScript(x=c_script.A)  # -> a
# ---------- python_2: Python ----------
__author__ = "ediga"
__version__ = "2020.08.24"

import rhinoscriptsyntax as rs

idx = x.index("KinergyMainInterface.gh")

a = x[0:idx] + "Resources\images\intosci.png"
# ---------- end python_2 ----------
height_18 = Slider(30, range=0..30)
width_18 = Slider(40, range=0..400)
width_19 = Slider(150, range=0..1000)
height_19 = Slider(80, range=0..1000)
panel_3 = Panel("""Slow
Regular
Fast""")
width_20 = Slider(117, range=0..1000)
height_20 = Slider(112, range=0..1000)
panel_4 = Panel(python_2)
label_7 = CreateLabel(LabelText="Max", LabelSize=12, Justification=0)
pulldown_3 = CreatePulldownMenu(Label="Amp", ListItems=panel_3, showLabel=True)
button = CreateButton(ButtonName="Set the input", ButtonStyle=0)
adjustpos_16 = AdjustElementPositioning(
    ElementsToAdjust=label_7,
    Margin="181,-55,0,5",
    AbsolutePositioning=False,
    Width=width_18,
    Height=height_18,
    HorizontalAlignment=Slider(0, range=0..100))
adjustelem_5 = AdjustElementAppearance(ElementsToAdjust=label_7, Background="255,255,255")
adjustpos_17 = AdjustElementPositioning(
    ElementsToAdjust=pulldown_3,
    Margin="216,-45,0,10",
    AbsolutePositioning=False,
    Width=width_16,
    Height=height_16,
    HorizontalAlignment=Slider(0, range=0..100))
adjustpos_18 = AdjustElementPositioning(
    ElementsToAdjust=button,
    Margin="10,-40,0,10",
    AbsolutePositioning=False,
    Width=width_17,
    Height=height_17,
    HorizontalAlignment=Slider(0, range=0..100))
image = CreateImage(ImageSource=panel_4, ImageWidth=width_20, ImageHeight=height_20)
adjustpos_19 = AdjustElementPositioning(
    ElementsToAdjust=image,
    Margin="240,-90,0,10",
    AbsolutePositioning=False,
    Width=width_19,
    Height=height_19,
    HorizontalAlignment=Slider(0, range=0..100))
separatorheight = Slider(4, range=0..10)
strength = Slider(4, range=0..9)
colour = ColourPicker(PickedColour=RGB(230, 230, 230))
speed_2 = Slider(2, range=0..4)
width_21 = Slider(210, range=0..1000)
height_21 = Slider(30, range=0..1000)
width_22 = Slider(200, range=0..400)
height_22 = Slider(30, range=0..30)
width_23 = Slider(210, range=0..1000)
height_23 = Slider(30, range=0..1000)
width_24 = Slider(305, range=0..400)
height_24 = Slider(30, range=0..30)
titlesize_2 = Slider(18, range=0..30)
separator = CreateSeparator(Thickness=0.5, Horizontal=True, Color=colour, Height=separatorheight)
colour_2 = ColourPicker(PickedColour=RGB(51, 121, 200))
button_2 = CreateButton(ButtonName="Select the end-effector", ButtonStyle=0)
slider_2 = CreateSlider(Slider=strength, ShowBounds=False, ShowTicks=False, ShowTooltip=False, ShowValLabel=True, showLabel=True)
slider_3 = CreateSlider(Slider=speed_2, ShowBounds=False, ShowTicks=False, ShowTooltip=False, ShowValLabel=True, showLabel=True)
button_3 = CreateButton(ButtonName="Select the region and axis", ButtonStyle=0)
width_25 = Slider(566, range=0..1000)
height_25 = Slider(38, range=0..1000)
adjustpos_20 = AdjustElementPositioning(
    ElementsToAdjust=slider_2,
    Margin="5,20,0,10",
    AbsolutePositioning=False,
    Width=width_22,
    Height=height_22,
    HorizontalAlignment=Slider(0, range=0..100))
adjustpos_21 = AdjustElementPositioning(
    ElementsToAdjust=button_2,
    Margin="10,5,0,10",
    AbsolutePositioning=False,
    Width=width_21,
    Height=height_21,
    HorizontalAlignment=Slider(0, range=0..100))
adjustpos_22 = AdjustElementPositioning(
    ElementsToAdjust=slider_3,
    Margin="5,10,0,5",
    AbsolutePositioning=False,
    Width=width_24,
    Height=height_24,
    HorizontalAlignment=Slider(0, range=0..100))
adjustpos_23 = AdjustElementPositioning(
    ElementsToAdjust=button_3,
    Margin="10,0,0,10",
    AbsolutePositioning=False,
    Width=width_23,
    Height=height_23,
    HorizontalAlignment=Slider(0, range=0..100))
colour_3 = ColourPicker(PickedColour=RGB(230, 230, 230))
separatorheight_2 = Slider(10, range=0..10)
true_button = CreateTrueOnlyButton(ButtonName="Preview", ButtonStyle=0)
width_26 = Slider(400, range=0..1000)
label_8 = CreateLabel(LabelText="Kinetic Unit for Intermittent Oscillation", LabelSize=12, Justification=0)
adjustelem_6 = AdjustElementAppearance(ElementsToAdjust=label_8, Foreground=colour_2, FontSize=titlesize_2)
adjustpos_24 = AdjustElementPositioning(
    ElementsToAdjust=label_8,
    Margin="0,5,0,10",
    AbsolutePositioning=False,
    Width=width_25,
    Height=height_25,
    HorizontalAlignment=Slider(0, range=0..100))
width_27 = Slider(80, range=0..1000)
height_26 = Slider(30, range=0..1000)
checkbox = CreateCheckbox(Label="Add a lock", StartingValue=False)
width_28 = Slider(450, range=0..1000)
width_29 = Slider(80, range=0..1000)
height_27 = Slider(30, range=0..1000)
height_28 = Slider(35, range=0..1000)
button_4 = CreateButton(ButtonName="Finish", ButtonStyle=0)
separator_2 = CreateSeparator(Thickness=0.5, Horizontal=True, Color=colour_3, Width=width_26, Height=separatorheight_2)
merge = Merge(
    Data1=separator,
    Data2=label_8,
    Data3=button_3,
    Data4=button_2,
    Data5=image,
    Data7=slider_2,
    Data8=pulldown_3,
    Data9=label_7,
    Data10=slider_3,
    Data11=label_6,
    Data13=separator_2,
    Data14=checkbox,
    Data15=true_button,
    Data16=button_4)
adjustpos_25 = AdjustElementPositioning(
    ElementsToAdjust=true_button,
    Margin="150,-45,0,10",
    AbsolutePositioning=False,
    Width=width_27,
    Height=height_26,
    HorizontalAlignment=Slider(0, range=0..100))
stack = CreateStack(UIElements=merge, Horizontal=Toggle(False))
adjustpos_26 = AdjustElementPositioning(
    ElementsToAdjust=button_4,
    Margin="240,-45,0,10",
    AbsolutePositioning=False,
    Width=width_29,
    Height=height_27,
    HorizontalAlignment=Slider(0, range=0..100))
adjustpos_27 = AdjustElementPositioning(ElementsToAdjust=checkbox, Margin="15,15,0,10", AbsolutePositioning=False, Width=width_28, Height=height_28)
hideshow = HideShowElement(ElementToHideShow=stack, Show=python.g, Collapse=Toggle(True), Disable=Toggle(False))

# ---- group: Reciprocation Control Panel
height_29 = Slider(30, range=0..30)
width_30 = Slider(50, range=0..400)
label_9 = CreateLabel(LabelText="Fastest", LabelSize=12, Justification=0)
adjustpos_28 = AdjustElementPositioning(
    ElementsToAdjust=label_9,
    Margin="181,-45,0,5",
    AbsolutePositioning=False,
    Width=width_30,
    Height=height_29,
    HorizontalAlignment=Slider(0, range=0..100))
adjustelem_7 = AdjustElementAppearance(ElementsToAdjust=label_9, Background="255,255,255")
height_30 = Slider(34, range=0..1000)
width_31 = Slider(110, range=0..1000)
width_32 = Slider(80, range=0..1000)
height_31 = Slider(30, range=0..1000)
panel_5 = Panel("""Uniform acceleration & deceleration
Slightly rising & suddenly falling""")
c_script_2 = CSharpScript()  # -> out, A; same code as c_script
height_32 = Slider(30, range=0..30)
width_33 = Slider(35, range=0..400)
python_3 = GhPythonScript(x=c_script_2.A)  # -> a
# ---------- python_3: Python ----------
__author__ = "ediga"
__version__ = "2020.08.24"

import rhinoscriptsyntax as rs

idx = x.index("KinergyMainInterface.gh")

a = x[0:idx] + "Resources\images\\reciprocate.png"
# ---------- end python_3 ----------
pulldown_4 = CreatePulldownMenu(Label="Pattern", ListItems=panel_5, showLabel=True)
width_34 = Slider(150, range=0..1000)
height_33 = Slider(80, range=0..1000)
width_35 = Slider(117, range=0..1000)
height_34 = Slider(112, range=0..1000)
label_10 = CreateLabel(LabelText="Max", LabelSize=12, Justification=0)
panel_6 = Panel(python_3)
button_5 = CreateButton(ButtonName="Set the input", ButtonStyle=0)
adjustpos_29 = AdjustElementPositioning(
    ElementsToAdjust=pulldown_4,
    Margin="218,-45,0,10",
    AbsolutePositioning=False,
    Width=width_31,
    Height=height_30,
    HorizontalAlignment=Slider(0, range=0..100))
adjustpos_30 = AdjustElementPositioning(
    ElementsToAdjust=label_10,
    Margin="181,-55,0,5",
    AbsolutePositioning=False,
    Width=width_33,
    Height=height_32,
    HorizontalAlignment=Slider(0, range=0..100))
adjustelem_8 = AdjustElementAppearance(ElementsToAdjust=label_10, Background="255,255,255")
adjustpos_31 = AdjustElementPositioning(
    ElementsToAdjust=button_5,
    Margin="10,-40,0,10",
    AbsolutePositioning=False,
    Width=width_32,
    Height=height_31,
    HorizontalAlignment=Slider(0, range=0..100))
image_2 = CreateImage(ImageSource=panel_6, ImageWidth=width_35, ImageHeight=height_34)
adjustpos_32 = AdjustElementPositioning(
    ElementsToAdjust=image_2,
    Margin="240,-90,0,10",
    AbsolutePositioning=False,
    Width=width_34,
    Height=height_33,
    HorizontalAlignment=Slider(0, range=0..100))
separatorheight_3 = Slider(4, range=0..10)
strength_2 = Slider(4, range=0..9)
colour_4 = ColourPicker(PickedColour=RGB(230, 230, 230))
speed_3 = Slider(2, range=0..4)
width_36 = Slider(210, range=0..1000)
height_35 = Slider(30, range=0..1000)
width_37 = Slider(200, range=0..400)
height_36 = Slider(30, range=0..30)
width_38 = Slider(210, range=0..1000)
height_37 = Slider(30, range=0..1000)
width_39 = Slider(180, range=0..400)
height_38 = Slider(30, range=0..30)
titlesize_3 = Slider(18, range=0..30)
separator_3 = CreateSeparator(Thickness=0.5, Horizontal=True, Color=colour_4, Height=separatorheight_3)
colour_5 = ColourPicker(PickedColour=RGB(51, 121, 200))
button_6 = CreateButton(ButtonName="Select the end-effector", ButtonStyle=0)
slider_4 = CreateSlider(Slider=strength_2, ShowBounds=False, ShowTicks=False, ShowTooltip=False, ShowValLabel=True, showLabel=True)
slider_5 = CreateSlider(Slider=speed_3, ShowBounds=False, ShowTicks=False, ShowTooltip=False, ShowValLabel=True, showLabel=True)
button_7 = CreateButton(ButtonName="Select the region and direction", ButtonStyle=0)
width_40 = Slider(566, range=0..1000)
height_39 = Slider(38, range=0..1000)
adjustpos_33 = AdjustElementPositioning(
    ElementsToAdjust=slider_4,
    Margin="5,20,0,10",
    AbsolutePositioning=False,
    Width=width_37,
    Height=height_36,
    HorizontalAlignment=Slider(0, range=0..100))
adjustpos_34 = AdjustElementPositioning(
    ElementsToAdjust=button_6,
    Margin="10,5,0,10",
    AbsolutePositioning=False,
    Width=width_36,
    Height=height_35,
    HorizontalAlignment=Slider(0, range=0..100))
adjustpos_35 = AdjustElementPositioning(
    ElementsToAdjust=slider_5,
    Margin="5,10,0,5",
    AbsolutePositioning=False,
    Width=width_39,
    Height=height_38,
    HorizontalAlignment=Slider(0, range=0..100))
adjustpos_36 = AdjustElementPositioning(
    ElementsToAdjust=button_7,
    Margin="10,0,0,10",
    AbsolutePositioning=False,
    Width=width_38,
    Height=height_37,
    HorizontalAlignment=Slider(0, range=0..100))
colour_6 = ColourPicker(PickedColour=RGB(230, 230, 230))
separatorheight_4 = Slider(10, range=0..10)
true_button_2 = CreateTrueOnlyButton(ButtonName="Preview", ButtonStyle=0)
width_41 = Slider(400, range=0..1000)
label_11 = CreateLabel(LabelText="Kinetic Unit for Reciprocation", LabelSize=12, Justification=0)
adjustelem_9 = AdjustElementAppearance(ElementsToAdjust=label_11, Foreground=colour_5, FontSize=titlesize_3)
adjustpos_37 = AdjustElementPositioning(
    ElementsToAdjust=label_11,
    Margin="0,5,0,10",
    AbsolutePositioning=False,
    Width=width_40,
    Height=height_39,
    HorizontalAlignment=Slider(0, range=0..100))
width_42 = Slider(80, range=0..1000)
height_40 = Slider(30, range=0..1000)
checkbox_2 = CreateCheckbox(Label="Add a lock", StartingValue=False)
width_43 = Slider(450, range=0..1000)
height_41 = Slider(35, range=0..1000)
width_44 = Slider(80, range=0..1000)
height_42 = Slider(30, range=0..1000)
button_8 = CreateButton(ButtonName="Finish", ButtonStyle=0)
separator_4 = CreateSeparator(Thickness=0.5, Horizontal=True, Color=colour_6, Width=width_41, Height=separatorheight_4)
merge_2 = Merge(
    Data1=separator_3,
    Data2=label_11,
    Data3=button_7,
    Data4=button_6,
    Data5=image_2,
    Data7=slider_4,
    Data8=pulldown_2,
    Data9=label_10,
    Data10=slider_5,
    Data11=label_9,
    Data12=pulldown_4,
    Data13=separator_4,
    Data14=checkbox_2,
    Data15=true_button_2,
    Data16=button_8)
adjustpos_38 = AdjustElementPositioning(
    ElementsToAdjust=true_button_2,
    Margin="150,-45,0,10",
    AbsolutePositioning=False,
    Width=width_42,
    Height=height_40,
    HorizontalAlignment=Slider(0, range=0..100))
stack_2 = CreateStack(UIElements=merge_2, Horizontal=Toggle(False))
adjustpos_39 = AdjustElementPositioning(
    ElementsToAdjust=button_8,
    Margin="240,-45,0,10",
    AbsolutePositioning=False,
    Width=width_44,
    Height=height_42,
    HorizontalAlignment=Slider(0, range=0..100))
adjustpos_40 = AdjustElementPositioning(ElementsToAdjust=checkbox_2, Margin="15,15,0,10", AbsolutePositioning=False, Width=width_43, Height=height_41)
hideshow_2 = HideShowElement(ElementToHideShow=stack_2, Show=python.f, Collapse=Toggle(True), Disable=Toggle(False))

# ---- group: Continuous Translation Control Panel
height_43 = Slider(30, range=0..30)
width_45 = Slider(80, range=0..1000)
height_44 = Slider(30, range=0..1000)
width_46 = Slider(50, range=0..400)
height_45 = Slider(30, range=0..30)
width_47 = Slider(50, range=0..400)
c_script_3 = CSharpScript()  # -> out, A; same code as c_script
python_4 = GhPythonScript(x=c_script_3.A)  # -> a
# ---------- python_4: Python ----------
__author__ = "ediga"
__version__ = "2020.08.24"

import rhinoscriptsyntax as rs

idx = x.index("KinergyMainInterface.gh")

a = x[0:idx] + "Resources\images\contrans.png"
# ---------- end python_4 ----------
width_48 = Slider(150, range=0..1000)
height_46 = Slider(80, range=0..1000)
label_12 = CreateLabel(LabelText="Fastest", LabelSize=12, Justification=0)
label_13 = CreateLabel(LabelText="Max", LabelSize=12, Justification=0)
width_49 = Slider(117, range=0..1000)
height_47 = Slider(112, range=0..1000)
panel_7 = Panel(python_4)
button_9 = CreateButton(ButtonName="Set the input", ButtonStyle=0)
adjustpos_41 = AdjustElementPositioning(
    ElementsToAdjust=label_12,
    Margin="181,-45,0,5",
    AbsolutePositioning=False,
    Width=width_46,
    Height=height_43,
    HorizontalAlignment=Slider(0, range=0..100))
adjustelem_10 = AdjustElementAppearance(ElementsToAdjust=label_12, Background="255,255,255")
adjustpos_42 = AdjustElementPositioning(
    ElementsToAdjust=label_13,
    Margin="290,-55,0,5",
    AbsolutePositioning=False,
    Width=width_47,
    Height=height_45,
    HorizontalAlignment=Slider(0, range=0..100))
adjustelem_11 = AdjustElementAppearance(ElementsToAdjust=label_13, Background="255,255,255")
adjustpos_43 = AdjustElementPositioning(
    ElementsToAdjust=button_9,
    Margin="10,-40,0,10",
    AbsolutePositioning=False,
    Width=width_45,
    Height=height_44,
    HorizontalAlignment=Slider(0, range=0..100))
image_3 = CreateImage(ImageSource=panel_7, ImageWidth=width_49, ImageHeight=height_47)
adjustpos_44 = AdjustElementPositioning(
    ElementsToAdjust=image_3,
    Margin="240,-90,0,10",
    AbsolutePositioning=False,
    Width=width_48,
    Height=height_46,
    HorizontalAlignment=Slider(0, range=0..100))
separatorheight_5 = Slider(4, range=0..10)
strength_3 = Slider(4, range=0..9)
colour_7 = ColourPicker(PickedColour=RGB(230, 230, 230))
speed_4 = Slider(3, range=0..9)
width_50 = Slider(210, range=0..1000)
height_48 = Slider(30, range=0..1000)
width_51 = Slider(305, range=0..400)
height_49 = Slider(30, range=0..30)
width_52 = Slider(210, range=0..1000)
height_50 = Slider(30, range=0..1000)
width_53 = Slider(138, range=0..400)
height_51 = Slider(30, range=0..30)
titlesize_4 = Slider(18, range=0..30)
separator_5 = CreateSeparator(Thickness=0.5, Horizontal=True, Color=colour_7, Height=separatorheight_5)
colour_8 = ColourPicker(PickedColour=RGB(51, 121, 200))
slider_6 = CreateSlider(Slider=strength_3, ShowBounds=False, ShowTicks=False, ShowTooltip=False, ShowValLabel=True, showLabel=True)
slider_7 = CreateSlider(Slider=speed_4, ShowBounds=False, ShowTicks=False, ShowTooltip=False, ShowValLabel=True, showLabel=True)
button_10 = CreateButton(ButtonName="Select the end-effector", ButtonStyle=0)
button_11 = CreateButton(ButtonName="Select the region and direction", ButtonStyle=0)
width_54 = Slider(566, range=0..1000)
height_52 = Slider(38, range=0..1000)
adjustpos_45 = AdjustElementPositioning(
    ElementsToAdjust=slider_6,
    Margin="5,20,0,10",
    AbsolutePositioning=False,
    Width=width_51,
    Height=height_49,
    HorizontalAlignment=Slider(0, range=0..100))
adjustpos_46 = AdjustElementPositioning(
    ElementsToAdjust=button_10,
    Margin="10,5,0,10",
    AbsolutePositioning=False,
    Width=width_50,
    Height=height_48,
    HorizontalAlignment=Slider(0, range=0..100))
adjustpos_47 = AdjustElementPositioning(
    ElementsToAdjust=slider_7,
    Margin="5,10,0,5",
    AbsolutePositioning=False,
    Width=width_53,
    Height=height_51,
    HorizontalAlignment=Slider(0, range=0..100))
adjustpos_48 = AdjustElementPositioning(
    ElementsToAdjust=button_11,
    Margin="10,0,0,10",
    AbsolutePositioning=False,
    Width=width_52,
    Height=height_50,
    HorizontalAlignment=Slider(0, range=0..100))
colour_9 = ColourPicker(PickedColour=RGB(230, 230, 230))
height_53 = Slider(35, range=0..1000)
separatorheight_6 = Slider(10, range=0..10)
true_button_3 = CreateTrueOnlyButton(ButtonName="Preview", ButtonStyle=0)
width_55 = Slider(400, range=0..1000)
label_14 = CreateLabel(LabelText="Kinetic Unit for Continuous Translation", LabelSize=12, Justification=0)
adjustelem_12 = AdjustElementAppearance(ElementsToAdjust=label_14, Foreground=colour_8, FontSize=titlesize_4)
adjustpos_49 = AdjustElementPositioning(
    ElementsToAdjust=label_14,
    Margin="0,5,0,10",
    AbsolutePositioning=False,
    Width=width_54,
    Height=height_52,
    HorizontalAlignment=Slider(0, range=0..100))
width_56 = Slider(450, range=0..1000)
width_57 = Slider(80, range=0..1000)
height_54 = Slider(30, range=0..1000)
checkbox_3 = CreateCheckbox(Label="Add a lock", StartingValue=False)
width_58 = Slider(80, range=0..1000)
height_55 = Slider(30, range=0..1000)
button_12 = CreateButton(ButtonName="Finish", ButtonStyle=0)
separator_6 = CreateSeparator(Thickness=0.5, Horizontal=True, Color=colour_9, Width=width_55, Height=separatorheight_6)
merge_3 = Merge(
    Data1=separator_5,
    Data2=label_14,
    Data3=button_11,
    Data4=button_10,
    Data5=image_3,
    Data7=slider_6,
    Data8=label_13,
    Data9=slider_7,
    Data10=pulldown,
    Data11=label_12,
    Data12=separator_6,
    Data13=checkbox_3,
    Data14=true_button_3,
    Data15=button_12)
adjustpos_50 = AdjustElementPositioning(ElementsToAdjust=checkbox_3, Margin="15,15,0,10", AbsolutePositioning=False, Width=width_56, Height=height_53)
adjustpos_51 = AdjustElementPositioning(
    ElementsToAdjust=true_button_3,
    Margin="150,-45,0,10",
    AbsolutePositioning=False,
    Width=width_57,
    Height=height_54,
    HorizontalAlignment=Slider(0, range=0..100))
stack_3 = CreateStack(UIElements=merge_3, Horizontal=Toggle(False))
adjustpos_52 = AdjustElementPositioning(
    ElementsToAdjust=button_12,
    Margin="240,-45,0,10",
    AbsolutePositioning=False,
    Width=width_58,
    Height=height_55,
    HorizontalAlignment=Slider(0, range=0..100))
hideshow_3 = HideShowElement(ElementToHideShow=stack_3, Show=python.c, Collapse=Toggle(True), Disable=Toggle(False))

# ---- group: Instant Rotation Control Panel
c_script_4 = CSharpScript()  # -> out, A; same code as c_script
python_5 = GhPythonScript(x=c_script_4.A)  # -> a
# ---------- python_5: Python ----------
__author__ = "ediga"
__version__ = "2020.08.24"

import rhinoscriptsyntax as rs

idx = x.index("KinergyMainInterface.gh")

a = x[0:idx] + "Resources\images\insrot.png"
# ---------- end python_5 ----------
width_59 = Slider(150, range=0..1000)
height_56 = Slider(80, range=0..1000)
height_57 = Slider(30, range=0..30)
width_60 = Slider(50, range=0..400)
width_61 = Slider(117, range=0..1000)
height_58 = Slider(112, range=0..1000)
panel_8 = Panel(python_5)
label_15 = CreateLabel(LabelText="Max", LabelSize=12, Justification=0)
textbox = CreateTextBox(Label="Max rotation angle (0°-360°):", UpdateButton=Toggle(False), showLabel=True)
adjustpos_53 = AdjustElementPositioning(
    ElementsToAdjust=label_15,
    Margin="290,-55,0,5",
    AbsolutePositioning=False,
    Width=width_60,
    Height=height_57,
    HorizontalAlignment=Slider(0, range=0..100))
adjustelem_13 = AdjustElementAppearance(ElementsToAdjust=label_15, Background="255,255,255")
image_4 = CreateImage(ImageSource=panel_8, ImageWidth=width_61, ImageHeight=height_58)
adjustpos_54 = AdjustElementPositioning(
    ElementsToAdjust=image_4,
    Margin="240,-90,0,10",
    AbsolutePositioning=False,
    Width=width_59,
    Height=height_56,
    HorizontalAlignment=Slider(0, range=0..100))
separatorheight_7 = Slider(4, range=0..10)
strength_4 = Slider(4, range=0..9)
colour_10 = ColourPicker(PickedColour=RGB(230, 230, 230))
width_62 = Slider(210, range=0..1000)
height_59 = Slider(30, range=0..1000)
width_63 = Slider(305, range=0..400)
height_60 = Slider(30, range=0..30)
width_64 = Slider(210, range=0..1000)
height_61 = Slider(30, range=0..1000)
width_65 = Slider(315, range=0..400)
height_62 = Slider(30, range=0..30)
titlesize_5 = Slider(18, range=0..30)
separator_7 = CreateSeparator(Thickness=0.5, Horizontal=True, Color=colour_10, Height=separatorheight_7)
colour_11 = ColourPicker(PickedColour=RGB(51, 121, 200))
button_13 = CreateButton(ButtonName="Select the end-effector", ButtonStyle=0)
slider_8 = CreateSlider(Slider=strength_4, ShowBounds=False, ShowTicks=False, ShowTooltip=False, ShowValLabel=True, showLabel=True)
button_14 = CreateButton(ButtonName="Select the region and axis", ButtonStyle=0)
width_66 = Slider(566, range=0..1000)
height_63 = Slider(38, range=0..1000)
adjustpos_55 = AdjustElementPositioning(
    ElementsToAdjust=slider_8,
    Margin="5,20,0,10",
    AbsolutePositioning=False,
    Width=width_63,
    Height=height_60,
    HorizontalAlignment=Slider(0, range=0..100))
adjustpos_56 = AdjustElementPositioning(
    ElementsToAdjust=button_13,
    Margin="10,5,0,10",
    AbsolutePositioning=False,
    Width=width_62,
    Height=height_59,
    HorizontalAlignment=Slider(0, range=0..100))
adjustpos_57 = AdjustElementPositioning(
    ElementsToAdjust=textbox,
    Margin="5,10,0,5",
    AbsolutePositioning=False,
    Width=width_65,
    Height=height_62,
    HorizontalAlignment=Slider(0, range=0..100))
adjustpos_58 = AdjustElementPositioning(
    ElementsToAdjust=button_14,
    Margin="10,0,0,10",
    AbsolutePositioning=False,
    Width=width_64,
    Height=height_61,
    HorizontalAlignment=Slider(0, range=0..100))
colour_12 = ColourPicker(PickedColour=RGB(230, 230, 230))
separatorheight_8 = Slider(10, range=0..10)
width_67 = Slider(400, range=0..1000)
label_16 = CreateLabel(LabelText="Kinetic Unit for Instant Rotation", LabelSize=12, Justification=0)
adjustelem_14 = AdjustElementAppearance(ElementsToAdjust=label_16, Foreground=colour_11, FontSize=titlesize_5)
adjustpos_59 = AdjustElementPositioning(
    ElementsToAdjust=label_16,
    Margin="0,5,0,10",
    AbsolutePositioning=False,
    Width=width_66,
    Height=height_63,
    HorizontalAlignment=Slider(0, range=0..100))
true_button_4 = CreateTrueOnlyButton(ButtonName="Preview", ButtonStyle=0)
width_68 = Slider(80, range=0..1000)
height_64 = Slider(30, range=0..1000)
width_69 = Slider(450, range=0..1000)
height_65 = Slider(35, range=0..1000)
checkbox_4 = CreateCheckbox(Label="Add a lock", StartingValue=False)
width_70 = Slider(80, range=0..1000)
height_66 = Slider(30, range=0..1000)
button_15 = CreateButton(ButtonName="Finish", ButtonStyle=0)
separator_8 = CreateSeparator(Thickness=0.5, Horizontal=True, Color=colour_12, Width=width_67, Height=separatorheight_8)
merge_4 = Merge(
    Data1=separator_7,
    Data2=label_16,
    Data3=button_14,
    Data4=button_13,
    Data5=image_4,
    Data6=slider_8,
    Data7=label_15,
    Data8=textbox,
    Data9=separator_8,
    Data10=checkbox_4,
    Data11=true_button_4,
    Data12=button_15)
adjustpos_60 = AdjustElementPositioning(
    ElementsToAdjust=true_button_4,
    Margin="150,-45,0,10",
    AbsolutePositioning=False,
    Width=width_68,
    Height=height_64,
    HorizontalAlignment=Slider(0, range=0..100))
adjustpos_61 = AdjustElementPositioning(ElementsToAdjust=checkbox_4, Margin="15,15,0,10", AbsolutePositioning=False, Width=width_69, Height=height_65)
stack_4 = CreateStack(UIElements=merge_4, Horizontal=Toggle(False))
adjustpos_62 = AdjustElementPositioning(
    ElementsToAdjust=button_15,
    Margin="240,-45,0,10",
    AbsolutePositioning=False,
    Width=width_70,
    Height=height_66,
    HorizontalAlignment=Slider(0, range=0..100))
hideshow_4 = HideShowElement(ElementToHideShow=stack_4, Show=python.b, Collapse=Toggle(True), Disable=Toggle(False))

# ---- group: Intermittent Rotation Control Panel
width_71 = Slider(80, range=0..1000)
height_67 = Slider(30, range=0..1000)
height_68 = Slider(34, range=0..1000)
width_72 = Slider(140, range=0..1000)
c_script_5 = CSharpScript()  # -> out, A; same code as c_script
height_69 = Slider(30, range=0..30)
width_73 = Slider(50, range=0..400)
python_6 = GhPythonScript(x=c_script_5.A)  # -> a
# ---------- python_6: Python ----------
__author__ = "ediga"
__version__ = "2020.08.24"

import rhinoscriptsyntax as rs

idx = x.index("KinergyMainInterface.gh")

a = x[0:idx] + "Resources\images\introt.png"
# ---------- end python_6 ----------
height_70 = Slider(80, range=0..1000)
width_74 = Slider(150, range=0..1000)
width_75 = Slider(117, range=0..1000)
height_71 = Slider(112, range=0..1000)
panel_9 = Panel(python_6)
label_17 = CreateLabel(LabelText="Max", LabelSize=12, Justification=0)
textbox_2 = CreateTextBox(Label="Step angle:", UpdateButton=Toggle(False), showLabel=True)
button_16 = CreateButton(ButtonName="Set the input", ButtonStyle=0)
adjustpos_63 = AdjustElementPositioning(
    ElementsToAdjust=label_17,
    Margin="290,-55,0,5",
    AbsolutePositioning=False,
    Width=width_73,
    Height=height_69,
    HorizontalAlignment=Slider(0, range=0..100))
adjustelem_15 = AdjustElementAppearance(ElementsToAdjust=label_17, Background="255,255,255")
adjustpos_64 = AdjustElementPositioning(
    ElementsToAdjust=button_16,
    Margin="10,-40,0,10",
    AbsolutePositioning=False,
    Width=width_71,
    Height=height_67,
    HorizontalAlignment=Slider(0, range=0..100))
adjustpos_65 = AdjustElementPositioning(
    ElementsToAdjust=slider,
    Margin="110,-65,0,0",
    AbsolutePositioning=False,
    Width=width_72,
    Height=height_68,
    HorizontalAlignment=Slider(0, range=0..100))
image_5 = CreateImage(ImageSource=panel_9, ImageWidth=width_75, ImageHeight=height_71)
adjustpos_66 = AdjustElementPositioning(
    ElementsToAdjust=image_5,
    Margin="240,-90,0,10",
    AbsolutePositioning=False,
    Width=width_74,
    Height=height_70,
    HorizontalAlignment=Slider(0, range=0..100))
colour_13 = ColourPicker(PickedColour=RGB(230, 230, 230))
separatorheight_9 = Slider(4, range=0..10)
strength_5 = Slider(4, range=0..9)
width_76 = Slider(210, range=0..1000)
height_72 = Slider(30, range=0..1000)
width_77 = Slider(305, range=0..400)
height_73 = Slider(30, range=0..30)
width_78 = Slider(210, range=0..1000)
height_74 = Slider(30, range=0..1000)
colour_14 = ColourPicker(PickedColour=RGB(51, 121, 200))
width_79 = Slider(100, range=0..400)
height_75 = Slider(30, range=0..30)
titlesize_6 = Slider(18, range=0..30)
colour_15 = ColourPicker(PickedColour=RGB(230, 230, 230))
separator_9 = CreateSeparator(Thickness=0.5, Horizontal=True, Color=colour_13, Height=separatorheight_9)
button_17 = CreateButton(ButtonName="Select the end-effector", ButtonStyle=0)
slider_9 = CreateSlider(Slider=strength_5, ShowBounds=False, ShowTicks=False, ShowTooltip=False, ShowValLabel=True, showLabel=True)
button_18 = CreateButton(ButtonName="Select the region and axis", ButtonStyle=0)
width_80 = Slider(566, range=0..1000)
height_76 = Slider(38, range=0..1000)
adjustpos_67 = AdjustElementPositioning(
    ElementsToAdjust=slider_9,
    Margin="5,20,0,10",
    AbsolutePositioning=False,
    Width=width_77,
    Height=height_73,
    HorizontalAlignment=Slider(0, range=0..100))
adjustpos_68 = AdjustElementPositioning(
    ElementsToAdjust=button_17,
    Margin="10,5,0,10",
    AbsolutePositioning=False,
    Width=width_76,
    Height=height_72,
    HorizontalAlignment=Slider(0, range=0..100))
adjustpos_69 = AdjustElementPositioning(
    ElementsToAdjust=textbox_2,
    Margin="5,0,0,5",
    AbsolutePositioning=False,
    Width=width_79,
    Height=height_75,
    HorizontalAlignment=Slider(0, range=0..100))
adjustpos_70 = AdjustElementPositioning(
    ElementsToAdjust=button_18,
    Margin="10,0,0,10",
    AbsolutePositioning=False,
    Width=width_78,
    Height=height_74,
    HorizontalAlignment=Slider(0, range=0..100))
separatorheight_10 = Slider(10, range=0..10)
true_button_5 = CreateTrueOnlyButton(ButtonName="Preview", ButtonStyle=0)
width_81 = Slider(400, range=0..1000)
label_18 = CreateLabel(LabelText="Kinetic Unit for Intermittent Rotation", LabelSize=12, Justification=0)
adjustelem_16 = AdjustElementAppearance(ElementsToAdjust=label_18, Foreground=colour_14, FontSize=titlesize_6)
adjustpos_71 = AdjustElementPositioning(
    ElementsToAdjust=label_18,
    Margin="0,5,0,10",
    AbsolutePositioning=False,
    Width=width_80,
    Height=height_76,
    HorizontalAlignment=Slider(0, range=0..100))
width_82 = Slider(80, range=0..1000)
height_77 = Slider(30, range=0..1000)
separator_10 = CreateSeparator(Thickness=0.5, Horizontal=True, Color=colour_15, Width=width_81, Height=separatorheight_10)
checkbox_5 = CreateCheckbox(Label="Add a lock", StartingValue=False)
button_19 = CreateButton(ButtonName="Preview", ButtonStyle=0)
height_78 = Slider(35, range=0..1000)
width_83 = Slider(450, range=0..1000)
width_84 = Slider(80, range=0..1000)
height_79 = Slider(30, range=0..1000)
button_20 = CreateButton(ButtonName="Finish", ButtonStyle=0)
merge_5 = Merge(
    Data1=separator_9,
    Data2=label_18,
    Data3=button_18,
    Data4=button_17,
    Data5=image_5,
    Data7=slider_9,
    Data8=label_17,
    Data9=textbox_2,
    Data10=label,
    Data11=slider,
    Data12=label_2,
    Data13=separator_10,
    Data14=checkbox_5,
    Data15=true_button_5,
    Data16=button_20)
adjustpos_72 = AdjustElementPositioning(
    ElementsToAdjust=true_button_5,
    Margin="150,-45,0,10",
    AbsolutePositioning=False,
    Width=width_82,
    Height=height_77,
    HorizontalAlignment=Slider(0, range=0..100))
stack_5 = CreateStack(UIElements=merge_5, Horizontal=Toggle(False))
adjustpos_73 = AdjustElementPositioning(ElementsToAdjust=checkbox_5, Margin="15,10,0,10", AbsolutePositioning=False, Width=width_83, Height=height_78)
adjustpos_74 = AdjustElementPositioning(
    ElementsToAdjust=button_20,
    Margin="240,-45,0,10",
    AbsolutePositioning=False,
    Width=width_84,
    Height=height_79,
    HorizontalAlignment=Slider(0, range=0..100))
hideshow_5 = HideShowElement(ElementToHideShow=stack_5, Show=python.h, Collapse=Toggle(True), Disable=Toggle(False))

# ---- group: Continuous Rotation Control Panel
width_85 = Slider(80, range=0..1000)
height_80 = Slider(30, range=0..1000)
height_81 = Slider(30, range=0..30)
width_86 = Slider(50, range=0..400)
c_script_6 = CSharpScript()  # -> out, A; same code as c_script
python_7 = GhPythonScript(x=c_script_6.A)  # -> a
# ---------- python_7: Python ----------
__author__ = "ediga"
__version__ = "2020.08.24"

import rhinoscriptsyntax as rs

idx = x.index("KinergyMainInterface.gh")

a = x[0:idx] + "Resources\images\conrot.png"
# ---------- end python_7 ----------
height_82 = Slider(30, range=0..30)
width_87 = Slider(50, range=0..400)
width_88 = Slider(150, range=0..1000)
height_83 = Slider(80, range=0..1000)
label_19 = CreateLabel(LabelText="Max", LabelSize=12, Justification=0)
width_89 = Slider(117, range=0..1000)
height_84 = Slider(112, range=0..1000)
panel_10 = Panel(python_7)
button_21 = CreateButton(ButtonName="Set the input", ButtonStyle=0)
label_20 = CreateLabel(LabelText="Fastest", LabelSize=12, Justification=0)
adjustpos_75 = AdjustElementPositioning(
    ElementsToAdjust=label_19,
    Margin="287,-55,0,5",
    AbsolutePositioning=False,
    Width=width_86,
    Height=height_81,
    HorizontalAlignment=Slider(0, range=0..100))
adjustelem_17 = AdjustElementAppearance(ElementsToAdjust=label_19, Background="255,255,255")
adjustpos_76 = AdjustElementPositioning(
    ElementsToAdjust=button_21,
    Margin="10,-40,0,10",
    AbsolutePositioning=False,
    Width=width_85,
    Height=height_80,
    HorizontalAlignment=Slider(0, range=0..100))
adjustpos_77 = AdjustElementPositioning(
    ElementsToAdjust=label_20,
    Margin="287,-45,0,5",
    AbsolutePositioning=False,
    Width=width_87,
    Height=height_82,
    HorizontalAlignment=Slider(0, range=0..100))
adjustelem_18 = AdjustElementAppearance(ElementsToAdjust=label_20, Background="255,255,255")
image_6 = CreateImage(ImageSource=panel_10, ImageWidth=width_89, ImageHeight=height_84)
adjustpos_78 = AdjustElementPositioning(
    ElementsToAdjust=image_6,
    Margin="240,-90,0,10",
    AbsolutePositioning=False,
    Width=width_88,
    Height=height_83,
    HorizontalAlignment=Slider(0, range=0..100))
separatorheight_11 = Slider(4, range=0..10)
strength_6 = Slider(4, range=0..9)
colour_16 = ColourPicker(PickedColour=RGB(230, 230, 230))
speed_5 = Slider(4, range=0..9)
width_90 = Slider(210, range=0..1000)
height_85 = Slider(30, range=0..1000)
width_91 = Slider(305, range=0..400)
height_86 = Slider(30, range=0..30)
width_92 = Slider(210, range=0..1000)
height_87 = Slider(30, range=0..1000)
width_93 = Slider(305, range=0..400)
height_88 = Slider(30, range=0..30)
titlesize_7 = Slider(18, range=0..30)
separator_11 = CreateSeparator(Thickness=0.5, Horizontal=True, Color=colour_16, Height=separatorheight_11)
colour_17 = ColourPicker(PickedColour=RGB(51, 121, 200))
button_22 = CreateButton(ButtonName="Select the end-effector", ButtonStyle=0)
slider_10 = CreateSlider(Slider=strength_6, ShowBounds=False, ShowTicks=False, ShowTooltip=False, ShowValLabel=True, showLabel=True)
slider_11 = CreateSlider(Slider=speed_5, ShowBounds=False, ShowTicks=False, ShowTooltip=False, ShowValLabel=True, showLabel=True)
button_23 = CreateButton(ButtonName="Select the region and axis", ButtonStyle=0)
width_94 = Slider(566, range=0..1000)
height_89 = Slider(38, range=0..1000)
adjustpos_79 = AdjustElementPositioning(
    ElementsToAdjust=slider_10,
    Margin="5,20,0,10",
    AbsolutePositioning=False,
    Width=width_91,
    Height=height_86,
    HorizontalAlignment=Slider(0, range=0..100))
adjustpos_80 = AdjustElementPositioning(
    ElementsToAdjust=button_22,
    Margin="10,5,0,10",
    AbsolutePositioning=False,
    Width=width_90,
    Height=height_85,
    HorizontalAlignment=Slider(0, range=0..100))
adjustpos_81 = AdjustElementPositioning(
    ElementsToAdjust=slider_11,
    Margin="5,10,0,5",
    AbsolutePositioning=False,
    Width=width_93,
    Height=height_88,
    HorizontalAlignment=Slider(0, range=0..100))
adjustpos_82 = AdjustElementPositioning(
    ElementsToAdjust=button_23,
    Margin="10,0,0,10",
    AbsolutePositioning=False,
    Width=width_92,
    Height=height_87,
    HorizontalAlignment=Slider(0, range=0..100))
colour_18 = ColourPicker(PickedColour=RGB(230, 230, 230))
separatorheight_12 = Slider(10, range=0..10)
width_95 = Slider(400, range=0..1000)
label_21 = CreateLabel(LabelText="Kinetic Unit for Continuous Rotation", LabelSize=12, Justification=0)
adjustelem_19 = AdjustElementAppearance(ElementsToAdjust=label_21, Foreground=colour_17, FontSize=titlesize_7)
adjustpos_83 = AdjustElementPositioning(
    ElementsToAdjust=label_21,
    Margin="0,5,0,10",
    AbsolutePositioning=False,
    Width=width_94,
    Height=height_89,
    HorizontalAlignment=Slider(0, range=0..100))
true_button_6 = CreateTrueOnlyButton(ButtonName="Preview", ButtonStyle=0)
width_96 = Slider(80, range=0..1000)
height_90 = Slider(30, range=0..1000)
width_97 = Slider(450, range=0..1000)
height_91 = Slider(35, range=0..1000)
checkbox_6 = CreateCheckbox(Label="Add a lock", StartingValue=False)
width_98 = Slider(80, range=0..1000)
height_92 = Slider(30, range=0..1000)
button_24 = CreateButton(ButtonName="Finish", ButtonStyle=0)
separator_12 = CreateSeparator(Thickness=0.5, Horizontal=True, Color=colour_18, Width=width_95, Height=separatorheight_12)
merge_6 = Merge(
    Data1=separator_11,
    Data2=label_21,
    Data3=button_23,
    Data4=button_22,
    Data5=image_6,
    Data7=slider_10,
    Data8=label_19,
    Data9=slider_11,
    Data10=label_20,
    Data11=separator_12,
    Data12=checkbox_6,
    Data13=true_button_6,
    Data14=button_24)
adjustpos_84 = AdjustElementPositioning(
    ElementsToAdjust=true_button_6,
    Margin="150,-45,0,10",
    AbsolutePositioning=False,
    Width=width_96,
    Height=height_90,
    HorizontalAlignment=Slider(0, range=0..100))
stack_6 = CreateStack(UIElements=merge_6, Horizontal=Toggle(False))
adjustpos_85 = AdjustElementPositioning(
    ElementsToAdjust=button_24,
    Margin="240,-45,0,10",
    AbsolutePositioning=False,
    Width=width_98,
    Height=height_92,
    HorizontalAlignment=Slider(0, range=0..100))
adjustpos_86 = AdjustElementPositioning(ElementsToAdjust=checkbox_6, Margin="15,15,0,10", AbsolutePositioning=False, Width=width_97, Height=height_91)
hideshow_6 = HideShowElement(ElementToHideShow=stack_6, Show=python.d, Collapse=Toggle(True), Disable=Toggle(False))

# ---- group: Default Control Panel
width_99 = Slider(860, range=0..1000)
height_93 = Slider(35, range=0..1000)
colour_19 = ColourPicker(PickedColour=RGB(200, 200, 200))
label_22 = CreateLabel(LabelText="Please select the target motion...", LabelSize=12, Justification=0)
adjustpos_87 = AdjustElementPositioning(
    ElementsToAdjust=label_22,
    Margin="75,100,0,10",
    AbsolutePositioning=False,
    Width=width_99,
    Height=height_93,
    HorizontalAlignment=Slider(0, range=0..100))
stack_7 = CreateStack(UIElements=label_22, Horizontal=Toggle(False))
hideshow_7 = HideShowElement(ElementToHideShow=stack_7, Show=python.e, Collapse=Toggle(True), Disable=Toggle(False))
adjustelem_20 = AdjustElementAppearance(ElementsToAdjust=label_22, Foreground=colour_19)

# ----
addlocklistener = ValueListener(Elements=checkbox_4, SomeProperty=True)  # -> Values, Indices
strengthlistener = ValueListener(Elements=slider_8, SomeProperty=True)  # -> Values, Indices
bakelistener = ValueListener(Elements=button_15, SomeProperty=True)  # -> Values, Indices
regionselectionlistener = ValueListener(Elements=button_14, SomeProperty=True)  # -> Values, Indices
addlocklistener_2 = ValueListener(Elements=checkbox_3, SomeProperty=True)  # -> Values, Indices
endeffectorselectionlistener = ValueListener(Elements=button_10, SomeProperty=True)  # -> Values, Indices
speedlistener = ValueListener(Elements=slider_7, SomeProperty=True)  # -> Values, Indices
previewlistener = ValueListener(Elements=true_button_3, SomeProperty=True)  # -> Values, Indices
strengthlistener_2 = ValueListener(Elements=slider_6, SomeProperty=True)  # -> Values, Indices
bakelistener_2 = ValueListener(Elements=button_12, SomeProperty=True)  # -> Values, Indices
speedlistener_2 = ValueListener(Elements=slider_11, SomeProperty=True)  # -> Values, Indices
regionselectionlistener_2 = ValueListener(Elements=button_23, SomeProperty=True)  # -> Values, Indices
endeffectorselectionlistener_2 = ValueListener(Elements=button_22, SomeProperty=True)  # -> Values, Indices
strengthlistener_3 = ValueListener(Elements=slider_10, SomeProperty=True)  # -> Values, Indices
addlocklistener_3 = ValueListener(Elements=checkbox_6, SomeProperty=True)  # -> Values, Indices
previewlistener_2 = ValueListener(Elements=true_button_6, SomeProperty=True)  # -> Values, Indices
bakelistener_3 = ValueListener(Elements=button_24, SomeProperty=True)  # -> Values, Indices
previewlistener_3 = ValueListener(Elements=true_button_5, SomeProperty=True)  # -> Values, Indices
regionselectionlistener_3 = ValueListener(Elements=button_11, SomeProperty=True)  # -> Values, Indices
endeffectorselectionlistener_3 = ValueListener(Elements=button_13, SomeProperty=True)  # -> Values, Indices
anglelistener = ValueListener(Elements=textbox, SomeProperty=True)  # -> Values, Indices
speedlistener_3 = ValueListener(Elements=slider, SomeProperty=True)  # -> Values, Indices
addlocklistener_4 = ValueListener(Elements=checkbox_5, SomeProperty=True)  # -> Values, Indices
stepanglelistener = ValueListener(Elements=textbox_2, SomeProperty=True)  # -> Values, Indices
distancelistener = ValueListener(Elements=pulldown, SomeProperty=True)  # -> Values, Indices
regionselectionlistener_4 = ValueListener(Elements=button_18, SomeProperty=True)  # -> Values, Indices
endeffectorselectionlistener_4 = ValueListener(Elements=button_17, SomeProperty=True)  # -> Values, Indices
previewlistener_4 = ValueListener(Elements=true_button_4, SomeProperty=True)  # -> Values, Indices
strengthlistener_4 = ValueListener(Elements=slider_9, SomeProperty=True)  # -> Values, Indices
amplitudelistener = ValueListener(Elements=pulldown_2, SomeProperty=True)  # -> Values, Indices
strengthlistener_5 = ValueListener(Elements=slider_4, SomeProperty=True)  # -> Values, Indices
speedlistener_4 = ValueListener(Elements=slider_5, SomeProperty=True)  # -> Values, Indices
endeffectorselectionlistener_5 = ValueListener(Elements=button_6, SomeProperty=True)  # -> Values, Indices
addlocklistener_5 = ValueListener(Elements=checkbox_2, SomeProperty=True)  # -> Values, Indices
regionselectionlistener_5 = ValueListener(Elements=button_7, SomeProperty=True)  # -> Values, Indices
previewlistener_5 = ValueListener(Elements=true_button_2, SomeProperty=True)  # -> Values, Indices
bakelistener_4 = ValueListener(Elements=button_8, SomeProperty=True)  # -> Values, Indices
bakelistener_5 = ValueListener(Elements=button_20, SomeProperty=True)  # -> Values, Indices
addlocklistener_6 = ValueListener(Elements=checkbox, SomeProperty=True)  # -> Values, Indices
endeffectorselectionlistener_6 = ValueListener(Elements=button_2, SomeProperty=True)  # -> Values, Indices
speedlistener_5 = ValueListener(Elements=slider_3, SomeProperty=True)  # -> Values, Indices
previewlistener_6 = ValueListener(Elements=true_button, SomeProperty=True)  # -> Values, Indices
regionselectionlistener_6 = ValueListener(Elements=button_3, SomeProperty=True)  # -> Values, Indices
strengthlistener_6 = ValueListener(Elements=slider_2, SomeProperty=True)  # -> Values, Indices
amplitudelistener_2 = ValueListener(Elements=pulldown_3, SomeProperty=True)  # -> Values, Indices
instant_rotation_visability = Panel(python.b)
instant_translation_visability = Panel(python.a)
continuous_translation_visability = Panel(python.c)
continuous_rotation_visability = Panel(python.d)
intermittent_oscillation_visability = Panel(python.g)
reciprocation_visability = Panel(python.f)
intermittent_rotation_visability = Panel(python.h)
default_visability = Panel(python.e)
ctmodule = ContinuousTranslationModule(
    RegionSelection=regionselectionlistener_3.Values,
    EndeffectorSetting=endeffectorselectionlistener.Values,
    AddLock=addlocklistener_2.Values,
    Preview=previewlistener.Values,
    Energy=strengthlistener_2.Values,
    Speed=speedlistener.Values,
    Distance=distancelistener.Values,
    ComponentsBake=bakelistener_2.Values)  # -> KineticUnit, Models, PreviewLauncher

# ---- group: Simulation for Instant Translation
height_94 = Slider(500, range=0..900)
width_100 = Slider(400, range=0..1440)
sph = Sphere(Base=PlaneXY(0, 0, 0), Radius=1)
button_25 = CreateButton(ButtonName="Load motion", ButtonStyle=0)
button_26 = CreateButton(ButtonName="Release", ButtonStyle=0)
_3dview = Create3DView(MeshToDisplay=sph, MeshColors=RGB(255, 0, 0), ViewWidth=width_100, ViewHeight=height_94)
merge_7 = Merge(Data1=button_25, Data2=button_26)
stack_8 = CreateStack(UIElements=merge_7, Horizontal=True)
rgb = ColourRGB(Alpha=255, Red="255", Green=0, Blue=0)
values_8 = ValueListener(Elements=button_26, SomeProperty=True)  # -> Values, Indices
values_9 = ValueListener(Elements=button_25, SomeProperty=True)  # -> Values, Indices
merge_8 = Merge(Data1=_3dview, Data2=stack_8)
height_95 = Slider(700, range=0..900)
width_101 = Slider(310, range=0..1440)
kms = KinergyMotionSimulatorForHumanUI(
    _3DView=_3dview,
    KineticUnitToSimulate=ctmodule.KineticUnit,
    MeshColors=rgb,
    Start=ctmodule.PreviewLauncher,
    Load=values_9.Values,
    Release=values_8.Values)
launchwin = LaunchWindow(
    Show=ctmodule.PreviewLauncher,
    Name="Kinergy Preview Window",
    Width=width_101,
    Height=height_95,
    ChildStatus=0,
    EnableHorizScroll=False)
addelems = AddElements(Window=launchwin, Elements=flatten(merge_8), DoVLChecking=True)  # -> AddedElements, ElementNames

# ----
irmoudle = InstantRotationModule(
    RegionSelection=regionselectionlistener.Values,
    EndeffectorSetting=endeffectorselectionlistener_3.Values,
    AddLock=addlocklistener.Values,
    Preview=previewlistener_4.Values,
    Energy=strengthlistener.Values,
    MaxAngle=anglelistener.Values,
    ComponentsBake=bakelistener.Values)  # -> KineticUnit, Models, PreviewLauncher

# ---- group: Simulation for Instant Translation
height_96 = Slider(500, range=0..900)
width_102 = Slider(400, range=0..1440)
sph_2 = Sphere(Base=PlaneXY(0, 0, 0), Radius=1)
button_27 = CreateButton(ButtonName="Load motion", ButtonStyle=0)
button_28 = CreateButton(ButtonName="Release", ButtonStyle=0)
_3dview_2 = Create3DView(MeshToDisplay=sph_2, MeshColors=RGB(255, 0, 0), ViewWidth=width_102, ViewHeight=height_96)
merge_9 = Merge(Data1=button_27, Data2=button_28)
stack_9 = CreateStack(UIElements=merge_9, Horizontal=True)
rgb_2 = ColourRGB(Alpha=255, Red="255", Green=0, Blue=0)
values_10 = ValueListener(Elements=button_28, SomeProperty=True)  # -> Values, Indices
values_11 = ValueListener(Elements=button_27, SomeProperty=True)  # -> Values, Indices
merge_10 = Merge(Data1=_3dview_2, Data2=stack_9)
height_97 = Slider(700, range=0..900)
width_103 = Slider(310, range=0..1440)
kms_2 = KinergyMotionSimulatorForHumanUI(
    _3DView=_3dview_2,
    KineticUnitToSimulate=irmoudle.KineticUnit,
    MeshColors=rgb_2,
    Start=irmoudle.PreviewLauncher,
    Load=values_11.Values,
    Release=values_10.Values)
launchwin_2 = LaunchWindow(
    Show=irmoudle.PreviewLauncher,
    Name="Kinergy Preview Window",
    Width=width_103,
    Height=height_97,
    ChildStatus=0,
    EnableHorizScroll=False)
addelems_2 = AddElements(Window=launchwin_2, Elements=flatten(merge_10), DoVLChecking=True)  # -> AddedElements, ElementNames

# ----
crmodule = ContinuousRotationModule(
    RegionSelection=regionselectionlistener_2.Values,
    EndeffectorSetting=endeffectorselectionlistener_2.Values,
    AddLock=addlocklistener_3.Values,
    Preview=previewlistener_2.Values,
    Energy=strengthlistener_3.Values,
    Speed=speedlistener_2.Values,
    ComponentsBake=bakelistener_3.Values)  # -> KineticUnit, Models, PreviewLauncher

# ---- group: Simulation for Instant Translation
height_98 = Slider(500, range=0..900)
width_104 = Slider(400, range=0..1440)
sph_3 = Sphere(Base=PlaneXY(0, 0, 0), Radius=1)
button_29 = CreateButton(ButtonName="Load motion", ButtonStyle=0)
button_30 = CreateButton(ButtonName="Release", ButtonStyle=0)
_3dview_3 = Create3DView(MeshToDisplay=sph_3, MeshColors=RGB(255, 0, 0), ViewWidth=width_104, ViewHeight=height_98)
merge_11 = Merge(Data1=button_29, Data2=button_30)
stack_10 = CreateStack(UIElements=merge_11, Horizontal=True)
rgb_3 = ColourRGB(Alpha=255, Red="255", Green=0, Blue=0)
values_12 = ValueListener(Elements=button_30, SomeProperty=True)  # -> Values, Indices
values_13 = ValueListener(Elements=button_29, SomeProperty=True)  # -> Values, Indices
merge_12 = Merge(Data1=_3dview_3, Data2=stack_10)
width_105 = Slider(310, range=0..1440)
height_99 = Slider(700, range=0..900)
kms_3 = KinergyMotionSimulatorForHumanUI(
    _3DView=_3dview_3,
    KineticUnitToSimulate=crmodule.KineticUnit,
    MeshColors=rgb_3,
    Start=crmodule.PreviewLauncher,
    Load=values_13.Values,
    Release=values_12.Values)
launchwin_3 = LaunchWindow(
    Show=crmodule.PreviewLauncher,
    Name="Kinergy Preview Window",
    Width=width_105,
    Height=height_99,
    ChildStatus=0,
    EnableHorizScroll=False)
addelems_3 = AddElements(Window=launchwin_3, Elements=flatten(merge_12), DoVLChecking=True)  # -> AddedElements, ElementNames

# ----
patternlistener = ValueListener(Elements=pulldown_4, SomeProperty=True)  # -> Values, Indices
bakelistener_6 = ValueListener(Elements=button_4, SomeProperty=True)  # -> Values, Indices
irmodule = IntermittentRotationModule(
    RegionSelection=regionselectionlistener_4.Values,
    EndeffectorSetting=endeffectorselectionlistener_4.Values,
    AddLock=addlocklistener_4.Values,
    Preview=previewlistener_3.Values,
    Energy=strengthlistener_4.Values,
    StepAngle=stepanglelistener.Values,
    Speed=speedlistener_3.Values,
    ComponentsBake=bakelistener_5.Values)  # -> KineticUnit, Models, PreviewLauncher

# ---- group: Simulation for Instant Translation
height_100 = Slider(500, range=0..900)
width_106 = Slider(400, range=0..1440)
sph_4 = Sphere(Base=PlaneXY(0, 0, 0), Radius=1)
button_31 = CreateButton(ButtonName="Load motion", ButtonStyle=0)
button_32 = CreateButton(ButtonName="Release", ButtonStyle=0)
_3dview_4 = Create3DView(MeshToDisplay=sph_4, MeshColors=RGB(255, 0, 0), ViewWidth=width_106, ViewHeight=height_100)
merge_13 = Merge(Data1=button_31, Data2=button_32)
stack_11 = CreateStack(UIElements=merge_13, Horizontal=True)
rgb_4 = ColourRGB(Alpha=255, Red="255", Green=0, Blue=0)
values_14 = ValueListener(Elements=button_32, SomeProperty=True)  # -> Values, Indices
values_15 = ValueListener(Elements=button_31, SomeProperty=True)  # -> Values, Indices
merge_14 = Merge(Data1=_3dview_4, Data2=stack_11)
width_107 = Slider(310, range=0..1440)
height_101 = Slider(700, range=0..900)
kms_4 = KinergyMotionSimulatorForHumanUI(
    _3DView=_3dview_4,
    KineticUnitToSimulate=irmodule.KineticUnit,
    MeshColors=rgb_4,
    Start=irmodule.PreviewLauncher,
    Load=values_15.Values,
    Release=values_14.Values)
launchwin_4 = LaunchWindow(
    Show=irmodule.PreviewLauncher,
    Name="Kinergy Preview Window",
    Width=width_107,
    Height=height_101,
    ChildStatus=0,
    EnableHorizScroll=False)
addelems_4 = AddElements(Window=launchwin_4, Elements=flatten(merge_14), DoVLChecking=True)  # -> AddedElements, ElementNames

# ----
iomodule = IntermittentOscillation(
    RegionSelection=regionselectionlistener_6.Values,
    EndeffectorSetting=endeffectorselectionlistener_6.Values,
    AddLock=addlocklistener_6.Values,
    Preview=previewlistener_6.Values,
    Energy=strengthlistener_6.Values,
    Amplitude=amplitudelistener_2.Values,
    Speed=speedlistener_5.Values,
    ComponentsBake=bakelistener_6.Values)  # -> KineticUnit, Models, PreviewLauncher

# ---- group: Simulation for Instant Translation
height_102 = Slider(500, range=0..900)
width_108 = Slider(400, range=0..1440)
sph_5 = Sphere(Base=PlaneXY(0, 0, 0), Radius=1)
button_33 = CreateButton(ButtonName="Load motion", ButtonStyle=0)
button_34 = CreateButton(ButtonName="Release", ButtonStyle=0)
_3dview_5 = Create3DView(MeshToDisplay=sph_5, MeshColors=RGB(255, 0, 0), ViewWidth=width_108, ViewHeight=height_102)
merge_15 = Merge(Data1=button_33, Data2=button_34)
stack_12 = CreateStack(UIElements=merge_15, Horizontal=True)
rgb_5 = ColourRGB(Alpha=255, Red="255", Green=0, Blue=0)
values_16 = ValueListener(Elements=button_34, SomeProperty=True)  # -> Values, Indices
values_17 = ValueListener(Elements=button_33, SomeProperty=True)  # -> Values, Indices
merge_16 = Merge(Data1=_3dview_5, Data2=stack_12)
width_109 = Slider(310, range=0..1440)
height_103 = Slider(700, range=0..900)
kms_5 = KinergyMotionSimulatorForHumanUI(
    _3DView=_3dview_5,
    KineticUnitToSimulate=iomodule.KineticUnit,
    MeshColors=rgb_5,
    Start=iomodule.PreviewLauncher,
    Load=values_17.Values,
    Release=values_16.Values)
launchwin_5 = LaunchWindow(
    Show=iomodule.PreviewLauncher,
    Name="Kinergy Preview Window",
    Width=width_109,
    Height=height_103,
    ChildStatus=0,
    EnableHorizScroll=False)
addelems_5 = AddElements(Window=launchwin_5, Elements=flatten(merge_16), DoVLChecking=True)  # -> AddedElements, ElementNames

# ----
rmodule = ReciprocationModule(
    RegionSelection=regionselectionlistener_5.Values,
    EndeffectorSetting=endeffectorselectionlistener_5.Values,
    AddLock=addlocklistener_5.Values,
    Preview=previewlistener_5.Values,
    Energy=strengthlistener_5.Values,
    Amplitude=amplitudelistener.Values,
    Speed=speedlistener_4.Values,
    Pattern=patternlistener.Values,
    ComponentsBake=bakelistener_4.Values)  # -> KineticUnit, Models, PreviewLauncher

# ---- group: Simulation for Instant Translation
height_104 = Slider(500, range=0..900)
width_110 = Slider(400, range=0..1440)
sph_6 = Sphere(Base=PlaneXY(0, 0, 0), Radius=1)
button_35 = CreateButton(ButtonName="Load motion", ButtonStyle=0)
button_36 = CreateButton(ButtonName="Release", ButtonStyle=0)
_3dview_6 = Create3DView(MeshToDisplay=sph_6, MeshColors=RGB(255, 0, 0), ViewWidth=width_110, ViewHeight=height_104)
merge_17 = Merge(Data1=button_35, Data2=button_36)
stack_13 = CreateStack(UIElements=merge_17, Horizontal=True)
rgb_6 = ColourRGB(Alpha=255, Red="255", Green=0, Blue=0)
values_18 = ValueListener(Elements=button_36, SomeProperty=True)  # -> Values, Indices
values_19 = ValueListener(Elements=button_35, SomeProperty=True)  # -> Values, Indices
merge_18 = Merge(Data1=_3dview_6, Data2=stack_13)
height_105 = Slider(700, range=0..900)
width_111 = Slider(310, range=0..1440)
kms_6 = KinergyMotionSimulatorForHumanUI(
    _3DView=_3dview_6,
    KineticUnitToSimulate=rmodule.KineticUnit,
    MeshColors=rgb_6,
    Start=rmodule.PreviewLauncher,
    Load=values_19.Values,
    Release=values_18.Values)
launchwin_6 = LaunchWindow(
    Show=rmodule.PreviewLauncher,
    Name="Kinergy Preview Window",
    Width=width_111,
    Height=height_105,
    ChildStatus=0,
    EnableHorizScroll=False)
addelems_6 = AddElements(Window=launchwin_6, Elements=flatten(merge_18), DoVLChecking=True)  # -> AddedElements, ElementNames

# ---- group: Reset Motion
width_112 = Slider(50, range=0..1000)
height_106 = Slider(30, range=0..1000)
button_37 = CreateButton(ButtonName="Clear", ButtonStyle=0)
adjustpos_88 = AdjustElementPositioning(
    ElementsToAdjust=button_37,
    Margin="270,-45,0,10",
    AbsolutePositioning=False,
    Width=width_112,
    Height=height_106,
    HorizontalAlignment=Slider(0, range=0..100))
values_20 = ValueListener(Elements=button_37, SomeProperty=True)  # -> Values, Indices

# ---- group: Instant Translation Control Panel
c_script_7 = CSharpScript()  # -> out, A; same code as c_script
python_8 = GhPythonScript(x=c_script_7.A)  # -> a
# ---------- python_8: Python ----------
__author__ = "ediga"
__version__ = "2020.08.24"

import rhinoscriptsyntax as rs

idx = x.index("KinergyMainInterface.gh")

a = x[0:idx] + "Resources\images\instrans.png"
# ---------- end python_8 ----------
width_113 = Slider(150, range=0..1000)
height_107 = Slider(80, range=0..1000)
height_108 = Slider(30, range=0..30)
width_114 = Slider(50, range=0..400)
width_115 = Slider(117, range=0..1000)
height_109 = Slider(112, range=0..1000)
height_110 = Slider(30, range=0..30)
width_116 = Slider(50, range=0..400)
panel_11 = Panel(python_8)
label_23 = CreateLabel(LabelText="Max", LabelSize=12, Justification=0)
label_24 = CreateLabel(LabelText="Max", LabelSize=12, Justification=0)
adjustpos_89 = AdjustElementPositioning(
    ElementsToAdjust=label_23,
    Margin="290,-50,0,5",
    AbsolutePositioning=False,
    Width=width_114,
    Height=height_108,
    HorizontalAlignment=Slider(0, range=0..100))
adjustelem_21 = AdjustElementAppearance(ElementsToAdjust=label_23, Background="255,255,255")
adjustpos_90 = AdjustElementPositioning(
    ElementsToAdjust=label_24,
    Margin="290,-55,0,5",
    AbsolutePositioning=False,
    Width=width_116,
    Height=height_110,
    HorizontalAlignment=Slider(0, range=0..100))
image_7 = CreateImage(ImageSource=panel_11, ImageWidth=width_115, ImageHeight=height_109)
adjustpos_91 = AdjustElementPositioning(
    ElementsToAdjust=image_7,
    Margin="240,-90,0,10",
    AbsolutePositioning=False,
    Width=width_113,
    Height=height_107,
    HorizontalAlignment=Slider(0, range=0..100))
adjustelem_22 = AdjustElementAppearance(ElementsToAdjust=label_24, Background="255,255,255")
strength_7 = Slider(4, range=0..9)
separatorheight_13 = Slider(4, range=0..10)
displacement = Slider(4, range=0..9)
colour_20 = ColourPicker(PickedColour=RGB(230, 230, 230))
width_117 = Slider(210, range=0..1000)
height_111 = Slider(30, range=0..1000)
width_118 = Slider(305, range=0..400)
height_112 = Slider(30, range=0..30)
width_119 = Slider(305, range=0..400)
height_113 = Slider(30, range=0..30)
width_120 = Slider(210, range=0..1000)
height_114 = Slider(30, range=0..1000)
slider_12 = CreateSlider(Slider=strength_7, ShowBounds=False, ShowTicks=False, ShowTooltip=False, ShowValLabel=True, showLabel=True)
titlesize_8 = Slider(18, range=0..30)
separator_13 = CreateSeparator(Thickness=0.5, Horizontal=True, Color=colour_20, Height=separatorheight_13)
colour_21 = ColourPicker(PickedColour=RGB(51, 121, 200))
button_38 = CreateButton(ButtonName="Select the end-effector", ButtonStyle=0)
slider_13 = CreateSlider(Slider=displacement, ShowBounds=False, ShowTicks=False, ShowTooltip=False, ShowValLabel=True, showLabel=True)
button_39 = CreateButton(ButtonName="Select the region and direction", ButtonStyle=0)
width_121 = Slider(566, range=0..1000)
height_115 = Slider(38, range=0..1000)
panel_12 = Panel("Kinetic Unit for Instant Translation")
adjustpos_92 = AdjustElementPositioning(
    ElementsToAdjust=slider_13,
    Margin="5,20,0,10",
    AbsolutePositioning=False,
    Width=width_118,
    Height=height_112,
    HorizontalAlignment=Slider(0, range=0..100))
adjustpos_93 = AdjustElementPositioning(
    ElementsToAdjust=button_38,
    Margin="10,5,0,10",
    AbsolutePositioning=False,
    Width=width_117,
    Height=height_111,
    HorizontalAlignment=Slider(0, range=0..100))
adjustpos_94 = AdjustElementPositioning(
    ElementsToAdjust=button_39,
    Margin="10,0,0,10",
    AbsolutePositioning=False,
    Width=width_120,
    Height=height_114,
    HorizontalAlignment=Slider(0, range=0..100))
adjustpos_95 = AdjustElementPositioning(
    ElementsToAdjust=slider_12,
    Margin="5,10,0,5",
    AbsolutePositioning=False,
    Width=width_119,
    Height=height_113,
    HorizontalAlignment=Slider(0, range=0..100))
colour_22 = ColourPicker(PickedColour=RGB(230, 230, 230))
separatorheight_14 = Slider(10, range=0..10)
width_122 = Slider(400, range=0..1000)
true_button_7 = CreateTrueOnlyButton(ButtonName="Preview", ButtonStyle=0)
width_123 = Slider(80, range=0..1000)
height_116 = Slider(30, range=0..1000)
width_124 = Slider(450, range=0..1000)
checkbox_7 = CreateCheckbox(Label="Add a lock", StartingValue=False)
height_117 = Slider(35, range=0..1000)
width_125 = Slider(80, range=0..1000)
height_118 = Slider(30, range=0..1000)
button_40 = CreateButton(ButtonName="Finish", ButtonStyle=0)
separator_14 = CreateSeparator(Thickness=0.5, Horizontal=True, Color=colour_22, Width=width_122, Height=separatorheight_14)
adjustpos_96 = AdjustElementPositioning(
    ElementsToAdjust=true_button_7,
    Margin="150,-45,0,10",
    AbsolutePositioning=False,
    Width=width_123,
    Height=height_116,
    HorizontalAlignment=Slider(0, range=0..100))
adjustpos_97 = AdjustElementPositioning(ElementsToAdjust=checkbox_7, Margin="15,15,0,10", AbsolutePositioning=False, Width=width_124, Height=height_117)
adjustpos_98 = AdjustElementPositioning(
    ElementsToAdjust=button_40,
    Margin="240,-45,0,10",
    AbsolutePositioning=False,
    Width=width_125,
    Height=height_118,
    HorizontalAlignment=Slider(0, range=0..100))

# ----
label_25 = CreateLabel(LabelText=panel_12, LabelSize=12, Justification=0)

# ---- group: Instant Translation Control Panel (continued)
adjustelem_23 = AdjustElementAppearance(ElementsToAdjust=label_25, Foreground=colour_21, FontSize=titlesize_8)
adjustpos_99 = AdjustElementPositioning(
    ElementsToAdjust=label_25,
    Margin="0,5,0,10",
    AbsolutePositioning=False,
    Width=width_121,
    Height=height_115,
    HorizontalAlignment=Slider(0, range=0..100))
merge_19 = Merge(
    Data1=separator_13,
    Data2=label_25,
    Data3=button_39,
    Data4=button_38,
    Data5=image_7,
    Data6=slider_13,
    Data7=label_24,
    Data8=slider_12,
    Data9=label_23,
    Data10=separator_14,
    Data11=checkbox_7,
    Data12=true_button_7,
    Data13=button_40)
stack_14 = CreateStack(UIElements=merge_19, Horizontal=Toggle(False))
hideshow_8 = HideShowElement(ElementToHideShow=stack_14, Show=python.a, Collapse=Toggle(True), Disable=Toggle(False))

# ----
lockvaluelistener = ValueListener(Elements=checkbox_7, SomeProperty=True)  # -> Values, Indices
displacementvaluelistener = ValueListener(Elements=slider_13, SomeProperty=True)  # -> Values, Indices
previewvaluelistener = ValueListener(Elements=true_button_7, SomeProperty=True)  # -> Values, Indices
setregionvaluelistener = ValueListener(Elements=button_39, SomeProperty=True)  # -> Values, Indices
bakelistener_7 = ValueListener(Elements=button_40, SomeProperty=True)  # -> Values, Indices
setendeffectorvaluelistener = ValueListener(Elements=button_38, SomeProperty=True)  # -> Values, Indices
energyvaluelistener = ValueListener(Elements=slider_12, SomeProperty=True)  # -> Values, Indices
itmoudle = InstantTranslationModule(
    RegionSelection=setregionvaluelistener.Values,
    EndeffectorSetting=setendeffectorvaluelistener.Values,
    AddLock=lockvaluelistener.Values,
    Preview=previewvaluelistener.Values,
    CompressionDisplacement=displacementvaluelistener.Values,
    Energy=energyvaluelistener.Values,
    ComponentsBake=bakelistener_7.Values)  # -> KineticUnit, Models, PreviewLauncher

# ---- group: Simulation for Instant Translation
height_119 = Slider(500, range=0..900)
width_126 = Slider(400, range=0..1440)
sph_7 = Sphere(Base=PlaneXY(0, 0, 0), Radius=1)
button_41 = CreateButton(ButtonName="Load motion", ButtonStyle=0)
button_42 = CreateButton(ButtonName="Release", ButtonStyle=0)
_3dview_7 = Create3DView(MeshToDisplay=sph_7, MeshColors=RGB(255, 0, 0), ViewWidth=width_126, ViewHeight=height_119)
merge_20 = Merge(Data1=button_41, Data2=button_42)
stack_15 = CreateStack(UIElements=merge_20, Horizontal=True)
rgb_7 = ColourRGB(Alpha=255, Red="255", Green=0, Blue=0)
values_21 = ValueListener(Elements=button_42, SomeProperty=True)  # -> Values, Indices
values_22 = ValueListener(Elements=button_41, SomeProperty=True)  # -> Values, Indices
merge_21 = Merge(Data1=_3dview_7, Data2=stack_15)
width_127 = Slider(310, range=0..1440)
height_120 = Slider(700, range=0..900)
kms_7 = KinergyMotionSimulatorForHumanUI(
    _3DView=_3dview_7,
    KineticUnitToSimulate=itmoudle.KineticUnit,
    MeshColors=rgb_7,
    Start=itmoudle.PreviewLauncher,
    Load=values_22.Values,
    Release=values_21.Values)
launchwin_7 = LaunchWindow(
    Show=itmoudle.PreviewLauncher,
    Name="Kinergy Preview Window",
    Width=width_127,
    Height=height_120,
    ChildStatus=0,
    EnableHorizScroll=False)
addelems_7 = AddElements(Window=launchwin_7, Elements=flatten(merge_21), DoVLChecking=True)  # -> AddedElements, ElementNames

# ---- group: MAIN WINDOW
merge_22 = Merge(
    Data1=label_5,
    Data2=label_4,
    Data3=radiobtn_5,
    Data4=radiobtn_7,
    Data5=radiobtn_6,
    Data6=label_3,
    Data7=radiobtn,
    Data8=radiobtn_2,
    Data9=radiobtn_3,
    Data10=radiobtn_4,
    Data11=stack_7,
    Data12=stack_14,
    Data13=stack_4,
    Data14=stack_3,
    Data15=stack_6,
    Data16=stack_2,
    Data17=stack,
    Data18=stack_5)
launchwin_8 = LaunchWindow(
    Show=Toggle(True),
    Name="Kinergy Design Tool",
    Width=Slider(350, range=0..1000),
    Height=Slider(630, range=0..1000),
    ChildStatus=0,
    EnableHorizScroll=False)
addelems_8 = AddElements(Window=launchwin_8, Elements=flatten(merge_22), DoVLChecking=True)  # -> AddedElements, ElementNames

# ----
childwin = MakeChildWindow(ParentWindow=launchwin_8, ChildWindow=launchwin_3)
childwin_2 = MakeChildWindow(ParentWindow=launchwin_8, ChildWindow=launchwin_4)
childwin_3 = MakeChildWindow(ParentWindow=launchwin_8, ChildWindow=launchwin_5)
childwin_4 = MakeChildWindow(ParentWindow=launchwin_8, ChildWindow=launchwin)
childwin_5 = MakeChildWindow(ParentWindow=launchwin_8, ChildWindow=launchwin_2)
childwin_6 = MakeChildWindow(ParentWindow=launchwin_8, ChildWindow=launchwin_6)
childwin_7 = MakeChildWindow(ParentWindow=launchwin_8, ChildWindow=launchwin_7)
